# Grasshopper definition assignment-01-Mircea Botezatu.gh (Grasshopper 1.0.8)

# ---- group: Auto-reloads cdf module on VScode changes
# Setting path for Src AutoReloader: 1. Right click on Path
# 2. Choose "Select a directory"
# 3. Locate the ..\cdf1_teaching\src folder in your computer
path = FilePath("/Users/mirceabotezatu/Documents/Workspace/cdf1_teaching/src/")
autoreloader = Python3Script(src_path=path)  # -> out; inputs src_path: String
# ---------- autoreloader: Python ----------
#! python3
import sys, os, time
import scriptcontext as sc
import Rhino, System
from System.IO import FileSystemWatcher, NotifyFilters

VERSION = 1  
pkg = "cdf"

if not src_path:
    raise Exception("Connect a folder to src_path.")
path = os.path.normpath(src_path)
watch_dir = os.path.join(path, pkg)
if not os.path.isdir(watch_dir):
    raise Exception("No '{}' folder found in:\n{}".format(pkg, path))

def unload():
    for name in list(sys.modules):
        if name == pkg or name.startswith(pkg + "."):
            del sys.modules[name]

# Put this folder first in Python's search list
if path in sys.path:
    sys.path.remove(path)
sys.path.insert(0, path)

key = "cdf_watcher_" + str(ghenv.Component.InstanceGuid)
time_key = key + "_time"
version_key = key + "_version"

def stamp():
    sc.sticky[time_key] = time.strftime("%Y-%m-%d %H:%M:%S")

# Replace the old watcher if the folder changed or the script was updated
old = sc.sticky.get(key)
if old is not None and (os.path.normpath(old.Path) != watch_dir
                        or sc.sticky.get(version_key) != VERSION):
    old.Dispose()
    del sc.sticky[key]
    unload()

if key not in sc.sticky:
    comp = ghenv.Component
    last = [0.0]

    def reload_and_rerun():
        unload()
        stamp()
        doc = comp.OnPingDocument()
        if doc is None:            # reloader was deleted or the file closed
            return
        for obj in doc.Objects:
            if "Python" in obj.GetType().Name:
                obj.ExpireSolution(False)   # mark as out of date
        doc.NewSolution(False)              # recompute once

    def on_change(sender, e):
        if not e.FullPath.endswith(".py") or "__pycache__" in e.FullPath:
            return
        if time.time() - last[0] < 0.5:     # ignore the second event of a double save
            return
        last[0] = time.time()
        Rhino.RhinoApp.InvokeOnUiThread(System.Action(reload_and_rerun))

    w = FileSystemWatcher(watch_dir, "*.py")
    w.IncludeSubdirectories = True
    w.NotifyFilter = NotifyFilters.LastWrite
    w.Changed += on_change
    w.EnableRaisingEvents = True
    sc.sticky[key] = w
    sc.sticky[version_key] = VERSION
    stamp()                                  # time the watcher started

msg = "Last reloaded: {}\nWatching: {}".format(sc.sticky.get(time_key, "unknown"), watch_dir)
print(msg)
out = msg
# ---------- end autoreloader ----------
panel = Panel(autoreloader)

# ----
construct_point = ConstructPoint(XCoordinate=0, YCoordinate=0, ZCoordinate=0)
base_boards = Python3Script(
    base_point=construct_point,
    board_length=Slider(50, range=34..66),
    board_thickness=Slider(2, range=0..10),
    first_intersection=Slider(0.49, range=0.25..0.75),
    second_intersection=Slider(0.5, range=0.25..0.75))  # -> out, a; inputs base_point: Point3d, board_length: Double, board_thickness: Double, first_intersection: Double, second_intersection: Double
# ---------- base_boards: Python ----------
import importlib
import cdf.assignment_1 as assignment_1

importlib.reload(assignment_1)

boards = assignment_1.create_intersecting_boards(
    base_point=base_point,
    board_length=board_length,
    board_thickness=board_thickness,
    first_intersection=first_intersection,
    second_intersection=second_intersection,
)

a = boards
# ---------- end base_boards ----------
list_item = ListItem(List=base_boards.a, Index="0", Wrap=True)
list_item_2 = ListItem(List=base_boards.a, Index="1", Wrap=True)
base_board = Python3Script(base_point=construct_point, board_thickness=Slider(3, range=1..10))  # -> out, a
# ---------- base_board: Python ----------
import importlib
import cdf.assignment_1 as assignment_1

importlib.reload(assignment_1)

a = assignment_1.create_support_board(
    base_point=base_point,
    board_thickness=board_thickness,
)
# ---------- end base_board ----------
additional_panels = Python3Script(
    first_board=list_item,
    second_board=list_item_2,
    panel_thickness=Slider(1, range=0..10),
    panel_length=Slider(60, range=30..100),
    panel_width=Slider(35, range=20..100),
    seed=Slider(12, range=1..12))  # -> out, a
# ---------- additional_panels: Python ----------
import importlib
import cdf.assignment_1 as assignment_1

importlib.reload(assignment_1)

a = assignment_1.create_additional_panels(
    first_board=first_board,
    second_board=second_board,
    panel_thickness=panel_thickness,
    panel_length=panel_length,
    panel_width=panel_width,
    seed=seed,
)
# ---------- end additional_panels ----------
boolean_intersection = Python3Script(
    first_board=list_item,
    second_board=list_item_2,
    additional_panels=additional_panels.a,
    tolerance=Slider(0.2, range=0..1))  # -> out, first_out, second_out, panels_out
# ---------- boolean_intersection: Python ----------
import importlib
import cdf.assignment_1 as assignment_1

importlib.reload(assignment_1)

first_result, second_result, panel_result = (
    assignment_1.cut_composition(
        first_board=first_board,
        second_board=second_board,
        additional_panels=additional_panels,
        tolerance=tolerance,
    )
)

first_out = first_result
second_out = second_result
panels_out = panel_result
# ---------- end boolean_intersection ----------
spheres = Python3Script(
    panels=additional_panels.a,
    first_board=list_item,
    second_board=list_item_2,
    sphere_clearance=Slider(0.706, range=0..1),
    sphere_scale=Slider(0.4, range=0..1))  # -> out, spheres, colors, radii, centers; inputs panels: Brep, first_board: Brep, second_board: Brep
# ---------- spheres: Python ----------
import importlib
import cdf.assignment_1 as assignment_1

importlib.reload(assignment_1)

spheres, colors, radii, centers = (
    assignment_1.create_colored_spheres(
        panels=panels,
        first_board=first_board,
        second_board=second_board,
        sphere_clearance=sphere_clearance,
        sphere_scale=sphere_scale,
    )
)
# ---------- end spheres ----------
custom_preview = CustomPreview(Geometry=spheres.spheres, Material=spheres.colors)
custom_preview_2 = CustomPreview(
    Geometry=[boolean_intersection.first_out, boolean_intersection.second_out, base_board.a, boolean_intersection.panels_out],
    Material=ColourSwatch(SwatchColor=RGB(255, 255, 255)))
