# Grasshopper definition geometry_basics.ghx (Grasshopper 1.0.8)

# ---- group: Auto-reloads cdf module on VScode changes
# Setting path for Src AutoReloader: 1. Right click on Path
# 2. Choose "Select a directory"
# 3. Locate the ..\cdf1_teaching\src folder in your computer
# NOTES:
# 
# - Use Python 3 Script blocks for your functions.
# - Import your functions and classes as: from cdf import my_function, My_class
# - Don't forget to add and name your INPUT and OUTPUT parameters that match your functions correctly. If you zoom in to the Python component you will see the + sign to add and - to remove them.
# - You need to attach the accurate components to your INPUT parameters: sliders for integers or floats, toggles or buttons for booleans, text for strings, Rhino geometries etc. etc.
# - If an INPUT is  a list, you need to right-click the parameter to set it as LIST access. Sometimes you need to also set the type of the INPUT by clicking TYPE HINT and selecting the correct input type.
# - If you want to hide an object, right-click component and uncheck Preview. To visualize again, check Preview.
# - If you get errors, READ THEM! They often tell what's wrong in a simple language. If not, copy-paste to CoPilot and don't be afraid to play around!
# 
# For more Grasshopper Help, go to:
# https://developer.rhino3d.com/guides/scripting/scripting-component/#script-inputs-and-outputs
path = FilePath("/Users/mirceabotezatu/Documents/Workspace/cdf1_teaching/src/")
autoreloader = Python3Script(src_path=path)  # -> out; inputs src_path: String
# ---------- autoreloader: Python ----------
#! python3
import sys, os, time
import scriptcontext as sc
import Rhino, System
from System.IO import FileSystemWatcher, NotifyFilters

VERSION = 1  
pkg = "cdf"

if not src_path:
    raise Exception("Connect a folder to src_path.")
path = os.path.normpath(src_path)
watch_dir = os.path.join(path, pkg)
if not os.path.isdir(watch_dir):
    raise Exception("No '{}' folder found in:\n{}".format(pkg, path))

def unload():
    for name in list(sys.modules):
        if name == pkg or name.startswith(pkg + "."):
            del sys.modules[name]

# Put this folder first in Python's search list
if path in sys.path:
    sys.path.remove(path)
sys.path.insert(0, path)

key = "cdf_watcher_" + str(ghenv.Component.InstanceGuid)
time_key = key + "_time"
version_key = key + "_version"

def stamp():
    sc.sticky[time_key] = time.strftime("%Y-%m-%d %H:%M:%S")

# Replace the old watcher if the folder changed or the script was updated
old = sc.sticky.get(key)
if old is not None and (os.path.normpath(old.Path) != watch_dir
                        or sc.sticky.get(version_key) != VERSION):
    old.Dispose()
    del sc.sticky[key]
    unload()

if key not in sc.sticky:
    comp = ghenv.Component
    last = [0.0]

    def reload_and_rerun():
        unload()
        stamp()
        doc = comp.OnPingDocument()
        if doc is None:            # reloader was deleted or the file closed
            return
        for obj in doc.Objects:
            if "Python" in obj.GetType().Name:
                obj.ExpireSolution(False)   # mark as out of date
        doc.NewSolution(False)              # recompute once

    def on_change(sender, e):
        if not e.FullPath.endswith(".py") or "__pycache__" in e.FullPath:
            return
        if time.time() - last[0] < 0.5:     # ignore the second event of a double save
            return
        last[0] = time.time()
        Rhino.RhinoApp.InvokeOnUiThread(System.Action(reload_and_rerun))

    w = FileSystemWatcher(watch_dir, "*.py")
    w.IncludeSubdirectories = True
    w.NotifyFilter = NotifyFilters.LastWrite
    w.Changed += on_change
    w.EnableRaisingEvents = True
    sc.sticky[key] = w
    sc.sticky[version_key] = VERSION
    stamp()                                  # time the watcher started

msg = "Last reloaded: {}\nWatching: {}".format(sc.sticky.get(time_key, "unknown"), watch_dir)
print(msg)
out = msg
# ---------- end autoreloader ----------
panel = Panel(autoreloader)

# ----
construct_point = ConstructPoint(XCoordinate=0, YCoordinate=0, ZCoordinate=0)

# ---- group: rectangle
vector_xyz = VectorXYZ(XComponent=expr("-x/2", 0), YComponent=expr("-x/2", 0), ZComponent=0)  # -> Vector, Length
move = Move(Geometry=construct_point, Motion=vector_xyz.Vector)  # -> Geometry, Transform
xy_plane = XYPlane(Origin=move.Geometry)
rectangle = Rectangle(Plane=xy_plane, XSize=Domain(-1, 1), YSize=Domain(-2, 2), Radius=0)  # -> Rectangle, Length

# ---- group: Exercise 1 / Example: Build a Parametric Cone
pt = Point(Point(-0.4439523925, 0.05137995213, 23.90921258))
cone = Python3Script(pt=pt, h=Slider(1, range=1..10), r=Slider(1, range=1..10))  # -> out, my_cone; inputs pt: Point3d
# ---------- cone: Python ----------
# import function
from cdf import create_cone

# call function
my_cone = create_cone(base_point=pt, height=h, radius=r)
# ---------- end cone ----------

# ---- group: Exercise 1
construct_point_2 = ConstructPoint(XCoordinate="0", YCoordinate="0", ZCoordinate="0")
unit_x = UnitX(Factor=1)
number_slider = Slider(2, range=1..10)
sphere_torus = Python3Script(
    center_point=pt,
    sphere_radius=Slider(5, range=1..10),
    major_radius=Slider(6, range=1..10),
    minor_radius=Slider(2, range=1..10),
    axis_origin=construct_point_2,
    axis_direction=unit_x,
    angle=Slider(0, range=0..360))  # -> out, a, b; inputs center_point: Point3d, sphere_radius: Double, major_radius: Double, minor_radius: Double, axis_origin: Point3d, axis_direction: Vector3d
# ---------- sphere_torus: Python ----------
from cdf.geometry_basics import (
    create_sphere,
    create_torus,
    rotate_brep_around_axis,
)

sphere = create_sphere(center_point, sphere_radius)

torus = create_torus(
    center_point,
    major_radius,
    minor_radius
)

a = rotate_brep_around_axis(
    sphere,
    axis_origin,
    axis_direction,
    angle
)

b = rotate_brep_around_axis(
    torus,
    axis_origin,
    axis_direction,
    angle
)
# ---------- end sphere_torus ----------

# ---- group: Exercise 1 / TODO: Build a Parametric Sphere
sphere = Python3Script(radius=number_slider)  # -> out, a; inputs center_point: Point3d, radius: Double
# ---------- sphere: Python ----------
from cdf.geometry_basics import create_sphere

a = create_sphere(center_point, radius)
# ---------- end sphere ----------

# ---- group: Exercise 1 / TODO: Make Transformations
transformation = Python3Script(my_sphere=sphere.a, distance=Slider(7, range=1..10), count=Slider(3, range=1..10))  # -> out, my_spheres; inputs my_sphere: Brep
# ---------- transformation: Python ----------
from cdf import copy_brep_along_z

my_spheres = copy_brep_along_z(my_sphere, distance, count)
# ---------- end transformation ----------

# ---- group: Exercise 1 / TODO: Make a Boolean Difference
boolean = Python3Script(my_cone=cone.my_cone, my_sphere=sphere.a)  # -> out, result_geometry

# ----
cube_layout = Python3Script(
    base_point=construct_point,
    cube_size=Slider(200, range=1..200),
    box_count=Slider(14, range=10..20),
    min_width=Slider(2, range=1..50),
    max_width=Slider(18, range=1..50),
    min_depth=Slider(2, range=1..50),
    max_depth=Slider(19, range=10..100),
    min_height=Slider(2, range=1..50),
    max_height=Slider(50, range=1..50),
    seed=Slider(1, range=1..12),
    show_hatch=Toggle(False),
    hatch_spacing=Slider(1.5, range=0.1..2),
    hatch_color=ColourSwatch(SwatchColor=RGB(31, 31, 31)),
    highlight_unstable=Toggle(True),
    stability_tolerance=Slider(0, range=0..1))  # -> out, geometry, colors; inputs base_point: Point3d, cube_size: Double, box_count: Double, min_width: Double, max_width: Double, min_depth: Double, max_depth: Double, min_height: Double, max_height: Double, seed: Double
# ---------- cube_layout: Python ----------
import sys

if "cdf.geometry_basics" in sys.modules:
    del sys.modules["cdf.geometry_basics"]

from cdf.geometry_basics import create_connected_3d_boxes

geometry, colors = create_connected_3d_boxes(
    base_point=base_point,
    cube_size=cube_size,
    box_count=box_count,
    min_width=min_width,
    max_width=max_width,
    min_depth=min_depth,
    max_depth=max_depth,
    min_height=min_height,
    max_height=max_height,
    seed=seed,
    show_hatch=show_hatch,
    hatch_spacing=hatch_spacing,
    hatch_color=hatch_color,
    highlight_unstable=highlight_unstable,
    stability_tolerance=stability_tolerance,
)
# ---------- end cube_layout ----------

# ---- group: Exercise 1 / Visualize
preview = CustomPreview(Geometry=cone.my_cone, Material=ColourSwatch(SwatchColor=RGB(60, 230, 88)))

preview_2 = CustomPreview(Geometry=sphere.a, Material=ColourSwatch(SwatchColor=RGB(255, 86, 88)))

preview_3 = CustomPreview(Geometry=boolean.result_geometry, Material=ColourSwatch(SwatchColor=RGB(255, 86, 255)))

preview_4 = CustomPreview(Geometry=transformation.my_spheres, Material=ColourSwatch(SwatchColor=RGB(97, 158, 255)))

preview_5 = CustomPreview(Geometry=[sphere_torus.a, sphere_torus.b], Material=ColourSwatch(SwatchColor=RGB(97, 158, 255)))

# ----
custom_preview = CustomPreview(Geometry=cube_layout.geometry, Material=cube_layout.colors)

# ---- group: exercise 2
number_slider_2 = Slider(20, range=0..20)
number_slider_3 = Slider(5, range=0..20)
construct_point_3 = ConstructPoint(XCoordinate="0", YCoordinate="0", ZCoordinate="0")
small_box = Python3Script(base_point=construct_point_3, width=number_slider_3, depth=number_slider_3, height=Slider(5, range=0..20))  # -> out, a; inputs base_point: Point3d
# ---------- small_box: Python ----------
from cdf.geometry_basics import create_box

a = create_box(
    base_point,
    width,
    depth,
    height
)
# ---------- end small_box ----------
large_box = Python3Script(base_point=construct_point_3, width=number_slider_2, depth=number_slider_2, height=Slider(5, range=0..20))  # -> out, a; inputs base_point: Point3d; same code as small_box
python_3_script = Python3Script(brep_a=large_box.a, brep_b=small_box.a)  # -> out, a; inputs brep_a: Brep, brep_b: Brep
# ---------- python_3_script: Python ----------
from cdf.geometry_basics import boolean_difference

a = boolean_difference(brep_a, brep_b)
# ---------- end python_3_script ----------
preview_6 = CustomPreview(Geometry=python_3_script.a, Material=ColourSwatch(SwatchColor=RGB(97, 158, 255)))

# ---- group: exercise 3
construct_point_4 = ConstructPoint(XCoordinate="0", YCoordinate="0", ZCoordinate="0")
exercise_3 = Python3Script(
    base_point=construct_point_4,
    cube_size=Slider(4, range=0..20),
    columns=Slider(4, range=0..20),
    rows=Slider(4, range=0..20),
    layers=Slider(9, range=0..20))  # -> out, a; inputs base_point: Point3d, cube_size: Double, columns: Double, rows: Double, layers: Double
# ---------- exercise_3: Python ----------
from cdf.geometry_basics import create_chequered_box

a = create_chequered_box(
    base_point,
    cube_size,
    columns,
    rows,
    layers
)
# ---------- end exercise_3 ----------
